# Dynamo graph dynamo_script_coordinates_export.dyn (Dynamo 3.3.0.6316)

python_script = Python()  # CPython3; unwired: IN[0]
# ---------- python_script.python (40 lines) ----------
# Load the Python Standard and DesignScript Libraries
import sys
import clr
clr.AddReference('ProtoGeometry')
from Autodesk.DesignScript.Geometry import *

import clr
clr.AddReference('RevitServices')
from RevitServices.Persistence import DocumentManager

clr.AddReference('RevitAPI')
clr.AddReference('RevitNodes')
import Autodesk
from Autodesk.Revit.DB import FilteredElementCollector, BuiltInCategory, Category, ElementId

# Get the active Revit document
doc = DocumentManager.Instance.CurrentDBDocument

# Get all categories in the document
categories = doc.Settings.Categories

# Initialize lists for storing data
element_ids = []
element_categories = []

# Loop through all categories and collect elements
for cat in categories:
    if cat.CategoryType == Autodesk.Revit.DB.CategoryType.Model:  # Only consider model categories
        try:
            # Collect all elements in the current category
            collector = FilteredElementCollector(doc).OfCategoryId(cat.Id).WhereElementIsNotElementType().ToElements()
            
            for elem in collector:
                element_ids.append(elem.Id.IntegerValue)  # Get the element ID
                element_categories.append(cat.Name)  # Get category name
        except:
            pass  # Skip categories that can't be filtered this way

# Output results
OUT = element_ids, element_categories
# ----------------------------------------
file_path = Filename(".\No file selected.xlsx")
code_block = CodeBlock { "Sheet4"; 0; 0; }
python_script_2 = Python()  # CPython3; unwired: IN[0]
# ---------- python_script_2.python (142 lines) ----------
import clr
clr.AddReference('RevitServices')
from RevitServices.Persistence import DocumentManager

import clr
clr.AddReference('RevitServices')
from RevitServices.Persistence import DocumentManager

clr.AddReference('RevitAPI')
clr.AddReference('RevitNodes')
import Autodesk
from Autodesk.Revit.DB import FilteredElementCollector, ElementId, Parameter, Location, LocationCurve, LocationPoint, BuiltInCategory

# Get the active Revit document
doc = DocumentManager.Instance.CurrentDBDocument

# Hard-coded list of excluded categories
excluded_categories = [
    "Levels", "Materials", "Phases", "Views", "Primary Contours", "Area Schemes", "Shared Site", "Work Plane Grid",
    "Revision", "Project Information", "Structural Load Cases", "Sun Path", "Internal Origin", "Elevations", "Cameras",
    "Section Boxes", "Color Fill Schema", "HVAC Zones", "HVAC Load Schedules", "Building Type Settings",
    "Space Type Settings", "Survey Point", "Project Base Point", "Electrical Demand Factor Definitions",
    "Electrical Load Classifications", "Panel Schedule Templates - Branch Panel",
    "Panel Schedule Templates - Data Panel", "Panel Schedule Templates - Switchboard",
    "Electrical Load Classification Parameter Element", "Material Assets", "Pipe Segments", "Legend Components",
    "Schedules", "Revision Numbering Sequences", "Area Based Load Type", "RVT Links", "Plumbing Equipment Tags",
    "Text Notes", "Pipe Tags", "Duct Tags", "Pipe Accessories", "Scope Boxes", "Sheets", "Title Blocks", "Viewports",
    "Guide Grid", "Plumbing Fixtures", "Reference Planes", "Raster Images", "Generic Annotations", "Lines", "Spaces",
    "Constraints", "Duct Systems", "Sun Path", "Pipe Tags", "Schedule Graphics", "Detail Items",
    "<Sketch>", "Automatic Sketch Dimensions", "Schedules", "Schedule Graphics", "Sun Path", "Work Plan Grid", "Materials"
]

# Define allowed BuiltInCategories (Only physical model elements)
allowed_categories = [
    BuiltInCategory.OST_PipeCurves,
    BuiltInCategory.OST_DuctCurves,
    BuiltInCategory.OST_Walls,
    BuiltInCategory.OST_Floors,
    BuiltInCategory.OST_StructuralFraming,
    BuiltInCategory.OST_Columns,
    BuiltInCategory.OST_MechanicalEquipment,
    BuiltInCategory.OST_PlumbingFixtures,
    BuiltInCategory.OST_StructuralColumns,
    BuiltInCategory.OST_Doors,
    BuiltInCategory.OST_Windows
]

# Collect all model elements
collector = FilteredElementCollector(doc).WhereElementIsNotElementType().ToElements()

# Initialize list for storing filtered elements
filtered_elements = []
for elem in collector:
    # Check that element has a valid category
    if not elem.Category:
        continue
    # Exclude elements whose category name is in the excluded list
    if elem.Category.Name in excluded_categories:
        continue
    # Only include elements whose category is one of our allowed BuiltInCategories.
    # Note: Allowed categories are stored as BuiltInCategory enum values; we compare using the integer value.
    if elem.Category.Id.IntegerValue in [int(cat) for cat in allowed_categories]:
        filtered_elements.append(elem)

# Initialize data list and add column headers (Ordered as requested)
data = []
headers = ["Element ID", "System Abbreviation", "Category", "Element Level", "Element Type", 
           "Element Size", "Element Length", "Element Name", 
           "System Classification", "System Type", "Building Location MTI", "Scope Const", "Scope Chord",
           "Start X", "Start Y", "Start Z", "End X", "End Y", "End Z"]
data.append(headers)

# Function to safely get a parameter value (returns blank if missing)
def get_param_value(element, param_name):
    param = element.LookupParameter(param_name)
    if param and param.HasValue:
        # Return the parameter as string or its value string
        return param.AsString() if param.StorageType == Autodesk.Revit.DB.StorageType.String else param.AsValueString()
    return ""

# Function to get the element type name
def get_element_type(element):
    try:
        element_type = doc.GetElement(element.GetTypeId()).Name
        return element_type if element_type else "Unknown Type"
    except:
        return "Unknown Type"

# Function to get start and end coordinates for an element
def get_element_coordinates(element):
    start_x = start_y = start_z = end_x = end_y = end_z = ""
    if isinstance(element.Location, LocationCurve):
        curve = element.Location.Curve
        start_pt = curve.GetEndPoint(0)
        end_pt = curve.GetEndPoint(1)
        start_x, start_y, start_z = start_pt.X, start_pt.Y, start_pt.Z
        end_x, end_y, end_z = end_pt.X, end_pt.Y, end_pt.Z
    elif isinstance(element.Location, LocationPoint):
        pt = element.Location.Point
        start_x, start_y, start_z = pt.X, pt.Y, pt.Z
    elif element.get_BoundingBox(None):
        bbox = element.get_BoundingBox(None)
        start_x, start_y, start_z = bbox.Min.X, bbox.Min.Y, bbox.Min.Z
        end_x, end_y, end_z = bbox.Max.X, bbox.Max.Y, bbox.Max.Z
    return start_x, start_y, start_z, end_x, end_y, end_z

# Loop through each filtered element and extract properties
for elem in filtered_elements:
    row = []
    row.append(elem.Id.IntegerValue)                                      # Element ID
    row.append(get_param_value(elem, "System Abbreviation"))                # System Abbreviation
    row.append(elem.Category.Name)                                          # Category
    row.append(get_param_value(elem, "Level"))                              # Element Level
    row.append(get_element_type(elem))                                      # Element Type
    row.append(get_param_value(elem, "Size"))                               # Element Size
    row.append(get_param_value(elem, "Length"))                             # Element Length
    
    # Element Name (fallback to "Family and Type" if "Name" is blank)
    name_val = get_param_value(elem, "Name")
    if name_val == "":
        name_val = get_param_value(elem, "Family and Type")
    row.append(name_val)                                                    # Element Name
    
    row.append(get_param_value(elem, "System Classification"))              # System Classification
    row.append(get_param_value(elem, "System Type"))                        # System Type
    row.append(get_param_value(elem, "Building Location MTI"))              # Building Location MTI
    row.append(get_param_value(elem, "Scope Const"))                        # Scope Const
    row.append(get_param_value(elem, "Scope Chord"))                        # Scope Chord

    # Get element coordinates (start and end)
    sx, sy, sz, ex, ey, ez = get_element_coordinates(elem)
    row.append(sx)  # Start X
    row.append(sy)  # Start Y
    row.append(sz)  # Start Z
    row.append(ex)  # End X
    row.append(ey)  # End Y
    row.append(ez)  # End Z

    data.append(row)

# Output the final formatted list for Excel export
OUT = data
# ----------------------------------------
exportToExcel = Data.ExportToExcel(filePath=file_path, sheetName=code_block.out0, startRow=code_block.out1, startColumn=code_block.out2, data=python_script_2)
file_path_2 = Filename("..\Documentos\Sector Test.xlsx")
file_from_path = FileObject(path=file_path_2)
string = StringInput("Sheet1")
importExcel = Data.ImportExcel(file=file_from_path, sheetName=string)
python_script_3 = Python(IN[0]=importExcel, IN[1]=python_script_2)  # CPython3
# ---------- python_script_3.python (80 lines) ----------
# Load the Python Standard and DesignScript Libraries
import sys
import clr
clr.AddReference('ProtoGeometry')
from Autodesk.DesignScript.Geometry import *


import clr
clr.AddReference('RevitServices')
from RevitServices.Persistence import DocumentManager

clr.AddReference('RevitAPI')
clr.AddReference('RevitNodes')
import Autodesk
from Autodesk.Revit.DB import FilteredElementCollector, ElementId, Parameter

import csv

# Get the active Revit document
doc = DocumentManager.Instance.CurrentDBDocument

# Read the sector boundaries from the input Excel table (IN[0])
sector_data = IN[0]  # Expected format: List of lists (from Dynamo's "Excel.ReadFromFile" node)

# Convert sector data into a list of dictionaries for easy lookup
sectors = []
for row in sector_data[1:]:  # Skip headers
    try:
        sector = {
            "Sector_Name": row[0],
            "X1": float(row[1]),
            "X2": float(row[2]),
            "Y1": float(row[3]),
            "Y2": float(row[4])
        }
        # Ensure X1 is always the smaller value
        sector["X1"], sector["X2"] = min(sector["X1"], sector["X2"]), max(sector["X1"], sector["X2"])
        # Ensure Y1 is always the smaller value
        sector["Y1"], sector["Y2"] = min(sector["Y1"], sector["Y2"]), max(sector["Y1"], sector["Y2"])
        sectors.append(sector)
    except ValueError:
        continue  # Skip rows with invalid values

# Get Revit elements from Dynamo input (IN[1])
element_data = IN[1]  # Expected format: List of lists (previous script output)

# Add a new column for "Sector Name"
headers = element_data[0] + ["Sector Name"]
updated_data = [headers]

# Function to determine which sector an element belongs to
def get_sector_name(x, y):
    try:
        x = float(x)
        y = float(y)
        for sector in sectors:
            if sector["X1"] <= x <= sector["X2"] and sector["Y1"] <= y <= sector["Y2"]:
                return sector["Sector_Name"]
        return ""  # If element is outside all defined sectors, return blank
    except ValueError:
        return ""  # Return blank if coordinates are not valid numbers

# Process each element
for row in element_data[1:]:  # Skip headers
    try:
        element_id = row[0]
        start_x = float(row[-6])  # Convert Start X to float
        start_y = float(row[-5])  # Convert Start Y to float

        # Get sector for the element based on Start X, Start Y
        sector_name = get_sector_name(start_x, start_y)

        # Append new data with sector name
        updated_row = row + [sector_name]
        updated_data.append(updated_row)
    except ValueError:
        updated_data.append(row + [""])  # Return blank if data conversion fails

# Output the final formatted list for Excel
OUT = updated_data
# ----------------------------------------
python_script_4 = Python(IN[0]=importExcel)  # CPython3
# ---------- python_script_4.python (48 lines) ----------
# Load the Python Standard and DesignScript Libraries
import sys
import clr
clr.AddReference('ProtoGeometry')
from Autodesk.DesignScript.Geometry import *

import clr
clr.AddReference('ProtoGeometry')
from Autodesk.DesignScript.Geometry import Point, Line

# Step 1: Read sector boundaries from the input (IN[0])
sector_data = IN[0]  # Expected format: List of lists from Excel or Dynamo

# Convert sector data into a list of dictionaries
sectors = []
for row in sector_data[1:]:  # Skip headers
    try:
        sector = {
            "Sector_Name": row[0],
            "X1": float(row[1]),
            "X2": float(row[2]),
            "Y1": float(row[3]),
            "Y2": float(row[4])
        }
        # Ensure X1 is always the smaller value
        sector["X1"], sector["X2"] = min(sector["X1"], sector["X2"]), max(sector["X1"], sector["X2"])
        # Ensure Y1 is always the smaller value
        sector["Y1"], sector["Y2"] = min(sector["Y1"], sector["Y2"]), max(sector["Y1"], sector["Y2"])
        sectors.append(sector)
    except ValueError:
        continue  # Skip invalid rows

# Step 2: Generate Dynamo geometry (lines)
lines = []
for sector in sectors:
    bottom_left = Point.ByCoordinates(sector["X1"], sector["Y1"], 0)
    bottom_right = Point.ByCoordinates(sector["X2"], sector["Y1"], 0)
    top_right = Point.ByCoordinates(sector["X2"], sector["Y2"], 0)
    top_left = Point.ByCoordinates(sector["X1"], sector["Y2"], 0)

    # Create boundary lines
    lines.append(Line.ByStartPointEndPoint(bottom_left, bottom_right))  # Bottom
    lines.append(Line.ByStartPointEndPoint(bottom_right, top_right))  # Right
    lines.append(Line.ByStartPointEndPoint(top_right, top_left))  # Top
    lines.append(Line.ByStartPointEndPoint(top_left, bottom_left))  # Left

# Output the list of lines to Dynamo
OUT = lines
# ----------------------------------------
python_script_5 = Python()  # CPython3; unwired: IN[0]
# ---------- python_script_5.python (59 lines) ----------
# Load the Python Standard and DesignScript Libraries
import sys
import clr
clr.AddReference('ProtoGeometry')
from Autodesk.DesignScript.Geometry import *

# Load Revit API and Dynamo Libraries
import clr
clr.AddReference('RevitServices')
from RevitServices.Persistence import DocumentManager

clr.AddReference('RevitAPI')
from Autodesk.Revit.DB import FilteredElementCollector, Element, Location, LocationCurve, LocationPoint, XYZ

clr.AddReference('ProtoGeometry')
from Autodesk.DesignScript.Geometry import Point, Line

# Get the active Revit document
doc = DocumentManager.Instance.CurrentDBDocument

# Step 1: Collect all elements from Revit (excluding element types)
collector = FilteredElementCollector(doc).WhereElementIsNotElementType().ToElements()

# Step 2: Extract element coordinates
points = []  # Store points for Dynamo visualization
lines = []  # Store lines for Dynamo visualization

for elem in collector:
    try:
        # Get the element location
        if isinstance(elem.Location, LocationCurve):  # Curved elements (e.g., pipes, ducts)
            start_pt = elem.Location.Curve.GetEndPoint(0)
            end_pt = elem.Location.Curve.GetEndPoint(1)

            # Convert to Dynamo Points
            start_point = Point.ByCoordinates(start_pt.X, start_pt.Y, start_pt.Z)
            end_point = Point.ByCoordinates(end_pt.X, end_pt.Y, end_pt.Z)

            # Add line to visualization
            lines.append(Line.ByStartPointEndPoint(start_point, end_point))

        elif isinstance(elem.Location, LocationPoint):  # Point-based elements (e.g., fixtures, furniture)
            pt = elem.Location.Point
            dyn_point = Point.ByCoordinates(pt.X, pt.Y, pt.Z)
            points.append(dyn_point)

        elif elem.get_BoundingBox(None):  # Elements with a bounding box (e.g., walls, floors)
            bbox = elem.get_BoundingBox(None)
            center_x = (bbox.Min.X + bbox.Max.X) / 2  # Get center of bounding box
            center_y = (bbox.Min.Y + bbox.Max.Y) / 2
            center_z = (bbox.Min.Z + bbox.Max.Z) / 2
            dyn_point = Point.ByCoordinates(center_x, center_y, center_z)
            points.append(dyn_point)

    except:
        continue  # Skip elements that fail

# Output all elements as Dynamo Points & Lines
OUT = (points, lines)
# ----------------------------------------
python_script_6 = Python()  # CPython3; unwired: IN[0]
# ---------- python_script_6.python (81 lines) ----------
# Load the Python Standard and DesignScript Libraries
import sys
import clr
clr.AddReference('ProtoGeometry')
from Autodesk.DesignScript.Geometry import *

# Load Revit API and Dynamo Libraries
import clr
clr.AddReference('RevitServices')
from RevitServices.Persistence import DocumentManager

clr.AddReference('RevitAPI')
from Autodesk.Revit.DB import FilteredElementCollector, Element, Location, LocationCurve, LocationPoint, XYZ

clr.AddReference('ProtoGeometry')
from Autodesk.DesignScript.Geometry import Point, Line

# Get the active Revit document
doc = DocumentManager.Instance.CurrentDBDocument

# Step 1: Collect all elements from Revit
collector = FilteredElementCollector(doc).WhereElementIsNotElementType().ToElements()

# Step 2: Define lists for normal and highlighted elements
points_normal = []
points_highlighted = []
lines_normal = []
lines_highlighted = []

# Define categories or conditions for highlighting
highlight_categories = ["Pipes", "Ducts"]  # Example: Highlight only Pipes & Ducts

for elem in collector:
    try:
        # Determine if the element should be highlighted
        category_name = elem.Category.Name if elem.Category else "Unknown"
        is_highlighted = category_name in highlight_categories

        # Get the element location
        if isinstance(elem.Location, LocationCurve):  # Curved elements (e.g., pipes, ducts)
            start_pt = elem.Location.Curve.GetEndPoint(0)
            end_pt = elem.Location.Curve.GetEndPoint(1)

            # Convert to Dynamo Points
            start_point = Point.ByCoordinates(start_pt.X, start_pt.Y, start_pt.Z)
            end_point = Point.ByCoordinates(end_pt.X, end_pt.Y, end_pt.Z)

            # Add to respective list based on highlight condition
            if is_highlighted:
                lines_highlighted.append(Line.ByStartPointEndPoint(start_point, end_point))
            else:
                lines_normal.append(Line.ByStartPointEndPoint(start_point, end_point))

        elif isinstance(elem.Location, LocationPoint):  # Point-based elements (e.g., fixtures, furniture)
            pt = elem.Location.Point
            dyn_point = Point.ByCoordinates(pt.X, pt.Y, pt.Z)

            # Add to respective list based on highlight condition
            if is_highlighted:
                points_highlighted.append(dyn_point)
            else:
                points_normal.append(dyn_point)

        elif elem.get_BoundingBox(None):  # Elements with a bounding box (e.g., walls, floors)
            bbox = elem.get_BoundingBox(None)
            center_x = (bbox.Min.X + bbox.Max.X) / 2  # Get center of bounding box
            center_y = (bbox.Min.Y + bbox.Max.Y) / 2
            center_z = (bbox.Min.Z + bbox.Max.Z) / 2
            dyn_point = Point.ByCoordinates(center_x, center_y, center_z)

            # Add to respective list based on highlight condition
            if is_highlighted:
                points_highlighted.append(dyn_point)
            else:
                points_normal.append(dyn_point)

    except:
        continue  # Skip elements that fail

# Output: Normal elements and highlighted elements separately
OUT = (points_normal, lines_normal, points_highlighted, lines_highlighted)
# ----------------------------------------
